# Grasshopper definition csvversion.gh (Grasshopper 1.0.7)

file = ReadFile(F="C:\_Python\GML-Grasshopper-connection\srf_ex_crv_id.csv", PerLineParse=True)  # -> C
#   port F: Uri of file to read
# ---------- file: VB line parser ----------
    action = GH_LineParserAction.Include
    Return line

    'Parse the line and return some data that represents the line.
    'If the line cannot be parsed, you can return Nothing and
    'assign a different action.
    'The default implementation is to just return the line itself.
    'If you return types that implement IGH_Goo, this component
    'will work substantially faster.
# ---------- end file ----------
file_2 = ReadFile(F="C:\_Python\GML-Grasshopper-connection\srf_in_crv_id.csv", PerLineParse=True)  # -> C; same code as file
file_3 = ReadFile(F="C:\_Python\GML-Grasshopper-connection\srf_id.csv", PerLineParse=True)  # -> C; same code as file
file_4 = ReadFile(F="C:\_Python\GML-Grasshopper-connection\points_id.csv", PerLineParse=True)  # -> C; same code as file
file_5 = ReadFile(F="C:\_Python\GML-Grasshopper-connection\area_建ぺい率.csv", PerLineParse=True)  # -> C; same code as file
file_6 = ReadFile(F="C:\_Python\GML-Grasshopper-connection\area_容積率.csv", PerLineParse=True)  # -> C; same code as file
file_7 = ReadFile(F="C:\_Python\GML-Grasshopper-connection\area_用途地域.csv", PerLineParse=True)  # -> C; same code as file
file_8 = ReadFile(F="C:\_Python\GML-Grasshopper-connection\points_y.csv", PerLineParse=True)  # -> C; same code as file
file_9 = ReadFile(F="C:\_Python\GML-Grasshopper-connection\points_x.csv", PerLineParse=True)  # -> C; same code as file
split = TextSplit(Text=file_3, Separators=",")
split_2 = TextSplit(Text=file, Separators=",")
split_3 = TextSplit(Text=file_2, Separators=",")
split_4 = TextSplit(Text=file_5, Separators=",")
split_5 = TextSplit(Text=file_6, Separators=",")
split_6 = TextSplit(Text=file_7, Separators=",")
split_7 = TextSplit(Text=file_4, Separators=",")
split_8 = TextSplit(Text=file_8, Separators=",")
split_9 = TextSplit(Text=file_9, Separators=",")
multiplication = Multiplication(A=split_8, B="1000")
multiplication_2 = Multiplication(A=split_9, B="1000")
gradient = Gradient(
    LowerLimit="30",
    UpperLimit="100",
    Parameter=split_4,
    stops=[0: RGB(243, 57, 0), 0.1: RGB(236, 27, 60), 0.2: RGB(210, 0, 118), 0.3: RGB(103, 0, 120), 0.4: RGB(39, 72, 161), 0.5: RGB(1, 192, 229), 0.6: RGB(18, 178, 90), 0.7: RGB(79, 186, 8), 0.8: RGB(220, 237, 32), 0.9: RGB(247, 159, 20), 1: RGB(243, 57, 0)])
pt = ConstructPoint(XCoordinate=multiplication_2, YCoordinate=multiplication, ZCoordinate="0")
pline = PolyLine(Vertices=pt, Closed="1")
keysearch = KeyValueSearch(Keys=flatten(split_7), Values=flatten(pline), Search=split_3)
keysearch_2 = KeyValueSearch(Keys=flatten(split_7), Values=flatten(pline), Search=split_2)
preview = CustomPreview(Geometry=keysearch, Material=ColourSwatch(SwatchColor=RGB(93, 255, 0)))
preview_2 = CustomPreview(Geometry=keysearch_2, Material=ColourSwatch(SwatchColor=RGB(255, 0, 0)))
merge = Merge(Data1=keysearch_2, Data2=keysearch)
boundary = BoundarySurfaces(Edges=merge)
area = Area(Geometry=boundary)  # -> Area, flatten(Centroid)
tag = TextTag(Location=area.Centroid, Text=split_4)
preview_3 = CustomPreview(Geometry=flatten(boundary), Material=gradient)
